# Grasshopper definition CellularPores.gh (Grasshopper 1.0.7)
# plug-ins: Kangaroo Components, PlanktonGh, Weaverbird, Kangaroo2 Components

cir = Circle(Plane=PlaneXY(0, 0, 0), Radius=Slider(303, range=0..500))
srf = Surface(cir)
mesh = Mesh(srf)
meshmachine = MeshMachine(
    Geometry=mesh,
    Length=Slider(70, range=0..100),
    FixCurves=cir,
    Flip=1,
    PullStrength=0.8,
    CurvatureAdaptivity=0,
    BoundaryScale=Slider(0.1, range=0..1),
    BoundaryDistance=Slider(150, range=0..150),
    Exponent=2,
    Background=0.5,
    Iterations=Slider(140, range=0..2000),
    Reset=Toggle(False))
pmesh = PlanktonMesh(meshmachine)
mesh_2 = Mesh(pmesh)
wbedges = WeaverbirdsMeshEdges(MeshOrPolylines=mesh_2)
nv = NakedVertices(Mesh=mesh_2)  # -> ClothedIndex, NakedIndex, ClothedPts, NakedPts
len = Length(Curve=wbedges)
pt = Point(nv.NakedPts)
merge = Merge(Data1=nv.ClothedPts, Data2=nv.NakedPts)
bnd = Bounds(Numbers=len)
remap = RemapNumbers(Value=len, Source=bnd, Target=Domain(0, 1))  # -> Mapped, Clipped
Z = UnitZ(Factor=Slider(100, range=0..100))
graph = GraphMapper(
    remap.Mapped,
    x0=0,
    x1=1,
    y0=0,
    y1=1,
    container_name="Bezier",
    cpx=[0, 0.2085792422, 0.4399873912, 1],
    cpy=[0.8611937761, 0.5456370115, 0.237658143, 0.2229924202])
neg = Negative(Value=Z)
uforce = UnaryForce(Point=merge, Force=neg)
multiplication = Multiplication(A=len, B=Slider(0.85, range=0..1))
multiplication_2 = Multiplication(A=graph, B=Slider(31.8, range=0..100))
springs = SpringsFromLine(
    Connection=wbedges,
    Stiffness=multiplication_2,
    Damping=Slider(6, range=0..10),
    RestLength=multiplication,
    UpperCutoff=0,
    LowerCutoff=0,
    Plasticity=0)
timer = Timer(TimerInterval=100, Target=kangaroo)
kangaroo = KangarooPhysics(
    ForceObjects=flatten([uforce, springs]),
    AnchorPoints=flatten(pt),
    Settings=null,
    Geometry=mesh_2,
    SimulationReset=Toggle(False))  # -> Out, Iterations, ParticlesOut, GeometryOut, KE
mesh_3 = Mesh(kangaroo.GeometryOut)
wbframe = WeaverbirdsPictureFrame(MeshPolylines=mesh_3, Distance=Slider(0.1, range=0..10), InsetType=0)
wbthicken = WeaverbirdsMeshThicken(MeshCurves=wbframe, Distance=Slider(5, range=0..10), OffsetType=0)
wbcatmullclark = WeaverbirdsCatmullClarkSubdivision(MeshCurves=wbthicken, Level=Slider(3, range=0..10), SmoothNakedEdges=Slider(1, range=0..10))
